# Grasshopper definition energy_Viz.gh (Grasshopper 0.9.76)
# plug-ins: Python Interpreter

path = FilePath("C:\Users\EllieHan\Dropbox\1_Jungmin&NJ\[DataScience_JTerm]\[release]\Day2\energy.csv")
panel = Panel(path)

# ---- group: Ellie Energy
python = PythonScript(fn=path, scale=Slider(50000, range=0..100000))  # -> out, a, b, Dis
# ---------- python: Python ----------
import Rhino as r

def OpenCSV(fn):
    file = open(fn, 'r')
    lines = file.readlines()
    file.close()
    return lines

file = OpenCSV(fn)

pos = []
EUILst =[]
diss= []

for i, d in enumerate(file):
    if(i==0):
        print d
    else:
        d1 = d.split(",")
        print d1
        y = float(d1[1])
        x = float(d1[2])
        EUITemp = float(d1[7])/scale
        
        pt1 = r.Geometry.Point3d(x,y,0)
        pt2 = r.Geometry.Point3d(x,y,EUITemp)
        dis = r.Geometry.Point3d.DistanceTo(pt1, pt2)
        
        pos.append(pt1)
        EUILst.append(pt2)
        diss.append(dis)
a = pos
b = EUILst
Dis = diss
# ---------- end python ----------

# ----
python_2 = PythonScript(data=python.Dis)  # -> out, a, b; inputs data: list
# ---------- python_2: Python ----------
a = min(data)
b = max(data)
# ---------- end python_2 ----------
ln = Line(StartPoint=python.a, EndPoint=python.b)
gradient = Gradient(
    LowerLimit=python_2.b,
    UpperLimit=python_2.a,
    Parameter=python.Dis,
    stops=[0: RGB(243, 57, 0), 0.1: RGB(236, 27, 60), 0.2: RGB(210, 0, 118), 0.3: RGB(103, 0, 120), 0.4: RGB(39, 72, 161), 0.5: RGB(1, 192, 229), 0.6: RGB(18, 178, 90), 0.7: RGB(79, 186, 8), 0.8: RGB(220, 237, 32), 0.9: RGB(247, 159, 20), 1: RGB(243, 57, 0)])
cir = Circle(Plane=ln, Radius="0.0001")
extr = Extrude(Base=cir, Direction=ln)
preview = CustomPreview(Geometry=extr, Shader=gradient)
