# Grasshopper definition ParamEG1.gh (Grasshopper 0.9.76)
# plug-ins: Python Interpreter

number_slider = Slider(62, range=0..100)
number_slider_2 = Slider(51, range=0..100)
open_weather_file = Ladybug_OpenEPWWeatherFile(open=Toggle(True))  # -> epwFile; plug-in component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
ladybug = Ladybug_Ladybug()  # -> Vviiiiiiiiiizzz; plug-in component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
importepw = Ladybug_ImportEpw(epwFile=open_weather_file)  # -> readMe, latitude, location, dryBulbTemperature, dewPointTemperature, relativeHumidity, windSpeed, windDirection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; plug-in component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
radiationanalysis = Ladybug_RadiationAnalysis(north=0)  # -> readMe, contextMesh, analysisMesh, testPts, testVec, port, radiationResult, radiationMesh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; plug-in component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
gencumulativeskymtx = Ladybug_GenCumulativeSkyMtx(epwFile=open_weather_file, skyDensity=0, useOldRes=True, runIt=Toggle(True))  # -> readMe, cumulativeSkyMtx; plug-in component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
analysisperiod = Ladybug_AnalysisPeriod(
    fromMonth=Slider(1, range=0..1),
    fromDay=Slider(1, range=0..1),
    fromHour=Slider(1, range=0..1),
    toMonth=Slider(12, range=0..100),
    toDay=Slider(31, range=0..100),
    toHour=Slider(24, range=0..100))  # -> readMe, analysisPeriod; plug-in component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
sunpath = Ladybug_SunPath(
    location=importepw.location,
    hour=12,
    day=21,
    month=12,
    timeStep=1,
    analysisPeriod=analysisperiod.analysisPeriod,
    dailyOrAnnualSunPath=True)  # -> readMe, sunVectors, sunAltitudes, sunAzimuths, port, sunSpheresMesh, sunPathCrvs, legend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; plug-in component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
selectskymtx = Ladybug_selectSkyMtx(
    cumulativeSkyMtx=gencumulativeskymtx.cumulativeSkyMtx,
    HOY=sunpath.sunPositionsHOY,
    analysisPeriod=analysisperiod.analysisPeriod,
    removeDiffuse=False,
    removeDirect=False)  # -> readMe, selectedSkyMtx; plug-in component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
panel = Panel(importepw.diffuseHorizontalRadiation)
panel_2 = Panel(Button())
panel_3 = Panel(selectskymtx.selectedSkyMtx)
number_slider_3 = Slider(4, range=0..10)

python = PythonScript()  # -> out, a
# ---------- python: Python ----------
print 44 * 2 * 10 + 60 * 2 * 10
# ---------- end python ----------
python_2 = PythonScript(height=Slider(8, range=0..10))  # -> out, a
# ---------- python_2: Python ----------
a = height
# ---------- end python_2 ----------
rectangle = Rectangle(Plane=PlaneXY(0, 0, 0), XSize=number_slider, YSize=number_slider_2, Radius=0)  # -> Rectangle, Length
series = Series(Start=0, Step=1, Count=number_slider_3)
python_3 = PythonScript(x=number_slider, y=number_slider_2)  # -> out, X, Y
# ---------- python_3: Python ----------
X = -x / 2;
Y = -y / 2;
# ---------- end python_3 ----------
Z = UnitZ(Factor=1)
Y = UnitY(Factor=python_3.Y)
python_4 = PythonScript(x=number_slider_3)  # -> out, a
# ---------- python_4: Python ----------
a = x-1
# ---------- end python_4 ----------
X = UnitX(Factor=python_3.X)
multiplication = Multiplication(A=python_2.a, B=series)
dom = ConstructDomain(DomainStart=" 0", DomainEnd=Slider(-1.232, range=-2..2))
move = Move(Geometry=rectangle.Rectangle, Motion=X)  # -> Geometry, Transform
Z_2 = UnitZ(Factor=python_2.a)
move_2 = Move(Geometry=move.Geometry, Motion=Y)  # -> Geometry, Transform
Z_3 = UnitZ(Factor=multiplication)
range = Range(Domain=dom, Steps=python_4.a)
move_3 = Move(Geometry=move_2.Geometry, Motion=Z_3)  # -> Geometry, Transform
area = Area(Geometry=move_2.Geometry)  # -> Area, Centroid
rotate = Rotate(Geometry=move_3.Geometry, Angle=Slider(-10.6, range=-20..10), Plane=area.Centroid)  # -> Geometry, Transform
area_2 = Area(Geometry=rectangle.Rectangle)  # -> Area, Centroid
rotate_2 = Rotate(Geometry=rotate.Geometry, Angle=range, Plane=area.Centroid)  # -> Geometry, Transform
panel_4 = Panel(area_2.Area)
extr = Extrude(Base=rotate_2.Geometry, Direction=Z_2)
area_3 = Area(Geometry=extr)  # -> Area, Centroid
python_5 = PythonScript(x=extr)  # -> out, a; inputs x: list
# ---------- python_5: Python ----------
a = x[-1]
# ---------- end python_5 ----------
python_6 = PythonScript(x=area_2.Area, y=area_3.Area)  # -> out, a; inputs y: list
# ---------- python_6: Python ----------
a = sum(y) + x
# ---------- end python_6 ----------
cap = CapHoles(Brep=python_5.a)

c_script = CSharpScript(x=python_6.a, y=extr, exe=Toggle(True))  # -> out, X, Y; inputs x: Double, y: list of Brep, exe: Boolean
# ---------- c_script: C# ----------
    if(exe){

      xL = x;
      yL = y;

    }


    X = xL;
    Y = yL;
# ---------- c_script: C# additional code ----------
  double xL = 0;
  List<Brep> yL = new List<Brep>();
# ---------- end c_script ----------
panel_5 = Panel([c_script.X, c_script.Y])
data = Data(c_script.X)
brep = Brep(c_script.Y)
panel_6 = Panel(data)
radiationanalysis_2 = Ladybug_RadiationAnalysis(
    north=0,
    geometry=flatten(brep),
    disFromBase="1",
    selectedSkyMtx=flatten(selectskymtx.selectedSkyMtx),
    runIt=Toggle(True))  # -> readMe, contextMesh, analysisMesh, testPts, testVec, port, radiationResult, radiationMesh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; plug-in component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
# Radiant Heat kWh/m2
# Multiplication
avr = Average(Input=radiationanalysis_2.radiationResult)  # -> flatten(ArithmeticMean)
panel_7 = Panel(avr)
multiplication_2 = Multiplication(A=avr, B=data)
c_script_2 = CSharpScript(data=multiplication_2, reset=Toggle(False))  # -> out, A; inputs data: list of Double, reset: Boolean
# ---------- c_script_2: C# ----------
    if(reset){

      d = new List<List<double>>();

    }
    d.Add(data);

    A = d;
# ---------- c_script_2: C# additional code ----------
  List<List<double>> d = new List<List<double>>();
# ---------- end c_script_2 ----------
rec = DataRecorder(multiplication_2, DataLimit=-10, RecordData=True)
python_7 = PythonScript(x=c_script_2.A)  # -> out, a; inputs x: list
# ---------- python_7: Python ----------
print x
# ---------- end python_7 ----------
panel_8 = Panel(python_7.out)
panel_9 = Panel(rec)
panel_10 = Panel(c_script_2.A)
panel_11 = Panel(multiplication_2)
# MassAddition : Total kWh
ma = MassAddition(Input=panel_11)  # -> Result, PartialResults
panel_12 = Panel(ma.Result)
graph = QuickGraph(panel_11)
